# Grasshopper definition 足球体构建.gh (Grasshopper 1.0.7)
# plug-ins: Vipers, Weaverbird, Kangaroo2 Components

# ---- group: 10
球的半径 = Slider(40, range=0..100)
point = Point(<point referenced from the Rhino model>)
sphere = Sphere(Base=point, Radius=球的半径)
weaverbird_s_mesh_mesh_icosahedron = WeaverbirdsMeshMeshIcosahedron(Plane=point, Radius=球的半径)
weaverbird_s_split_triangles_subdivision = WeaverbirdsSplitTrianglesSubdivision(MeshCurves=weaverbird_s_mesh_mesh_icosahedron, Level=Slider(10, range=5..24))
deconstruct_mesh = DeconstructMesh(Mesh=weaverbird_s_split_triangles_subdivision)  # -> Vertices, Faces, Colours, Normals
pull_point = PullPoint(Point=deconstruct_mesh.Vertices, Geometry=sphere, ClosestOnly=True)  # -> ClosestPoint, Distance
construct_mesh = ConstructMesh(Vertices=pull_point.ClosestPoint, Faces=deconstruct_mesh.Faces)
mesh_explode = MeshExplode(M=construct_mesh, N=True)  # -> out, A; inputs M: Mesh
# ---------- mesh_explode: VB ----------
    Component.Params.Input(0).Name = "Mesh"
    Component.Params.Input(0).Description = "Open or closed mesh"
    Component.Params.Input(1).Name = "Modify Normals"
    Component.Params.Input(1).Description = "An optional boolean that specifies whether vertex normals will be maintained if false or recalculated with the new face"

    Component.Params.Output(1).Name = "Mesh"
    Component.Params.Output(1).Description = "If successful, a list of valid meshes"

    If m IsNot Nothing Then
      Dim i As Integer

      Dim clrB As Boolean
      Dim mshs As New list(Of mesh)
      Dim mf As Rhino.Geometry.Collections.MeshFaceList = Nothing
      Dim mv As Rhino.Geometry.Collections.MeshVertexList = Nothing
      Dim mn As Rhino.Geometry.Collections.MeshVertexNormalList = Nothing
      Dim mc As Rhino.Geometry.Collections.MeshVertexColorList = Nothing

      If m.VertexColors.count() > 0 Then clrB = True Else m.VertexColors.CreateMonotoneMesh(color.White)
      If m.Normals.Count() < 1 Then m.Normals.ComputeNormals()
      mf = m.Faces
      mv = m.Vertices
      mn = m.Normals
      mc = m.VertexColors

      For i = 0 To mf.Count() - 1 Step 1
        Dim pts As New list(Of point3d)
        Dim fc As New meshFace
        Dim clr As New list(Of Color)
        Dim vec As New list(Of Vector3f)
        Dim msh As New mesh

        pts.add(New point3d(mv(mf(i).A)))
        pts.add(New point3d(mv(mf(i).B)))
        pts.add(New point3d(mv(mf(i).C)))
        If mf(i).IsQuad Then pts.add(New point3d(mv(mf(i).D)))

        clr.add(mc(mf(i).A))
        clr.add(mc(mf(i).B))
        clr.add(mc(mf(i).C))
        If mf(i).IsQuad Then clr.add(mc(mf(i).D))

        If N Then
          vec.add(mn(mf(i).A))
          vec.add(mn(mf(i).B))
          vec.add(mn(mf(i).C))
          If mf(i).IsQuad Then vec.add(mn(mf(i).D))
        End If

        If mf(i).IsQuad Then fc = New meshFace(0, 1, 2, 3) Else fc = New meshface(0, 1, 2)

        msh.Vertices.AddVertices(pts.toarray())
        msh.Faces.AddFace(fc)
        If clrB Then msh.VertexColors.AppendColors(clr.toarray())
        If N Then msh.Normals.AddRange(vec.toarray()) Else msh.Normals.ComputeNormals()
        mshs.add(msh)
      Next

      A = mshs
    End If
# ---------- end mesh_explode ----------
weaverbird_s_face_polylines = WeaverbirdsFacePolylines(Mesh=mesh_explode.A)
area = Area(Geometry=construct_mesh)  # -> Area, Centroid
deconstruct_mesh_2 = DeconstructMesh(Mesh=construct_mesh)  # -> Vertices, Faces, Colours, Normals
explode = Explode(Curve=weaverbird_s_face_polylines, Recursive=True)  # -> flatten(Segments), Vertices
point_2 = Point(area.Centroid)
removeduplicatelines = RemoveDuplicateLines(Lines=explode.Segments, Tolerance=0.01)  # -> flatten(UniqueLines)
scale = Scale(Geometry=removeduplicatelines, Center=point_2, Factor=Slider(1.32287, range=0..10))  # -> flatten(Geometry), Transform
end_points = EndPoints(Curve=scale.Geometry)  # -> Start, End
end_points_2 = EndPoints(Curve=removeduplicatelines)  # -> Start, End
removeduplicatepts = RemoveDuplicatePts(Points=end_points.Start, Tolerance=0.01)
removeduplicatepts_2 = RemoveDuplicatePts(Points=end_points_2.Start, Tolerance=0.01)
line = Line(StartPoint=removeduplicatepts_2, EndPoint=removeduplicatepts)

# ----
number_slider = Slider(20, range=0..100)

# ---- group: 9
球的半径_2 = Slider(40, range=0..100)
point_3 = Point(<point referenced from the Rhino model>)
sphere_2 = Sphere(Base=point_3, Radius=球的半径_2)
weaverbird_s_mesh_mesh_icosahedron_2 = WeaverbirdsMeshMeshIcosahedron(Plane=point_3, Radius=球的半径_2)
weaverbird_s_split_triangles_subdivision_2 = WeaverbirdsSplitTrianglesSubdivision(MeshCurves=weaverbird_s_mesh_mesh_icosahedron_2, Level=Slider(9, range=5..24))
deconstruct_mesh_3 = DeconstructMesh(Mesh=weaverbird_s_split_triangles_subdivision_2)  # -> Vertices, Faces, Colours, Normals
pull_point_2 = PullPoint(Point=deconstruct_mesh_3.Vertices, Geometry=sphere_2, ClosestOnly=True)  # -> ClosestPoint, Distance
construct_mesh_2 = ConstructMesh(Vertices=pull_point_2.ClosestPoint, Faces=deconstruct_mesh_3.Faces)
mesh_explode_2 = MeshExplode(M=construct_mesh_2, N=True)  # -> out, A; inputs M: Mesh; same code as mesh_explode
weaverbird_s_face_polylines_2 = WeaverbirdsFacePolylines(Mesh=mesh_explode_2.A)
area_2 = Area(Geometry=construct_mesh_2)  # -> Area, Centroid
deconstruct_mesh_4 = DeconstructMesh(Mesh=construct_mesh_2)  # -> Vertices, Faces, Colours, Normals
explode_2 = Explode(Curve=weaverbird_s_face_polylines_2, Recursive=True)  # -> flatten(Segments), Vertices
point_4 = Point(area_2.Centroid)
removeduplicatelines_2 = RemoveDuplicateLines(Lines=explode_2.Segments, Tolerance=0.01)  # -> flatten(UniqueLines)
scale_2 = Scale(Geometry=removeduplicatelines_2, Center=point_4, Factor=Slider(1.32287, range=0..10))  # -> flatten(Geometry), Transform
end_points_3 = EndPoints(Curve=scale_2.Geometry)  # -> Start, End
end_points_4 = EndPoints(Curve=removeduplicatelines_2)  # -> Start, End
removeduplicatepts_3 = RemoveDuplicatePts(Points=end_points_3.Start, Tolerance=0.01)
removeduplicatepts_4 = RemoveDuplicatePts(Points=end_points_4.Start, Tolerance=0.01)
line_2 = Line(StartPoint=removeduplicatepts_4, EndPoint=removeduplicatepts_3)

# ----
球的半径_3 = Slider(40, range=0..100)
point_5 = Point(<point referenced from the Rhino model>)
sphere_3 = Sphere(Base=point_5, Radius=球的半径_3)
weaverbird_s_mesh_mesh_icosahedron_3 = WeaverbirdsMeshMeshIcosahedron(Plane=point_5, Radius=球的半径_3)
weaverbird_s_split_triangles_subdivision_3 = WeaverbirdsSplitTrianglesSubdivision(MeshCurves=weaverbird_s_mesh_mesh_icosahedron_3, Level=Slider(6, range=5..24))
deconstruct_mesh_5 = DeconstructMesh(Mesh=weaverbird_s_split_triangles_subdivision_3)  # -> Vertices, Faces, Colours, Normals
pull_point_3 = PullPoint(Point=deconstruct_mesh_5.Vertices, Geometry=sphere_3, ClosestOnly=True)  # -> ClosestPoint, Distance
construct_mesh_3 = ConstructMesh(Vertices=pull_point_3.ClosestPoint, Faces=deconstruct_mesh_5.Faces)
mesh_explode_3 = MeshExplode(M=construct_mesh_3, N=True)  # -> out, A; inputs M: Mesh; same code as mesh_explode
weaverbird_s_face_polylines_3 = WeaverbirdsFacePolylines(Mesh=mesh_explode_3.A)
deconstruct_mesh_6 = DeconstructMesh(Mesh=construct_mesh_3)  # -> Vertices, Faces, Colours, Normals
area_3 = Area(Geometry=construct_mesh_3)  # -> Area, Centroid
explode_3 = Explode(Curve=weaverbird_s_face_polylines_3, Recursive=True)  # -> flatten(Segments), Vertices
point_6 = Point(area_3.Centroid)
removeduplicatelines_3 = RemoveDuplicateLines(Lines=explode_3.Segments, Tolerance=0.01)  # -> flatten(UniqueLines)
scale_3 = Scale(Geometry=removeduplicatelines_3, Center=point_6, Factor=Slider(1.32287, range=0..10))  # -> flatten(Geometry), Transform
end_points_5 = EndPoints(Curve=scale_3.Geometry)  # -> Start, End
end_points_6 = EndPoints(Curve=removeduplicatelines_3)  # -> Start, End
removeduplicatepts_5 = RemoveDuplicatePts(Points=end_points_5.Start, Tolerance=0.01)
removeduplicatepts_6 = RemoveDuplicatePts(Points=end_points_6.Start, Tolerance=0.01)
line_3 = Line(StartPoint=removeduplicatepts_6, EndPoint=removeduplicatepts_5)
removeduplicatelines_4 = RemoveDuplicateLines(Lines=explode_3.Segments, Tolerance=0.01)  # -> flatten(UniqueLines)
curve = Curve([<curve referenced from the Rhino model> x216])
removeduplicatelines_5 = RemoveDuplicateLines(Lines=curve, Tolerance=0.01)
param_viewer = ParamViewer(removeduplicatelines_5)
panel = Panel(removeduplicatelines_5)

球的半径_4 = Slider(40, range=0..100)
point_7 = Point(Point(2082.395829, -62.19846625, 0))
number_slider_2 = Slider(26, range=0..100)
point_8 = Point(<point referenced from the Rhino model>)
类足球形多面体 = 类足球形多面体(参考平面=point_7, 半径=Slider(40, range=0..100), 封面=False)  # -> 外轮廓, 多面体
hexagonal = Hexagonal(Plane=point_7, Size=Slider(4.3, range=0..10), ExtentX=number_slider, ExtentY=number_slider)  # -> flatten(Cells), Points
brep = Brep(<brep referenced from the Rhino model>)
weaverbird_s_polylines_dodecahedron = WeaverbirdsPolylinesDodecahedron(Plane=point_8, Radius=球的半径_4)
sphere_4 = Sphere(Base=point_8, Radius=球的半径_4)
number_slider_3 = Slider(16, range=0..100)
surface = Surface(<surface referenced from the Rhino model>)
六边形网格 = 六边形网格(曲面=brep, U方向数量=number_slider_2, V方向数量=number_slider_2)  # -> 网格, 网格点
point_9 = Point(flatten(hexagonal.Points))
weaverbird_s_split_triangles_subdivision_4 = WeaverbirdsSplitTrianglesSubdivision(MeshCurves=weaverbird_s_polylines_dodecahedron, Level=Slider(8, range=5..24))
project = Project(Curve=hexagonal.Cells, Brep=brep, Direction=Vector(0, 0, 1))
pull_point_4 = PullPoint(Point=point_9, Geometry=surface, ClosestOnly=True)  # -> ClosestPoint, Distance
六边形网格_2 = 六边形网格(U方向数量=number_slider_3, V方向数量=number_slider_3)  # -> 网格, 网格点
deconstruct_mesh_7 = DeconstructMesh(Mesh=weaverbird_s_split_triangles_subdivision_4)  # -> Vertices, Faces, Colours, Normals
pull_point_5 = PullPoint(Point=deconstruct_mesh_7.Vertices, Geometry=sphere_4, ClosestOnly=True)  # -> ClosestPoint, Distance
curve_2 = Curve(<curve referenced from the Rhino model>)
point_10 = Point(Point(2217.140929, -28.80613092, 0))
construct_mesh_4 = ConstructMesh(Vertices=pull_point_5.ClosestPoint, Faces=deconstruct_mesh_7.Faces)
mesh_explode_4 = MeshExplode(M=construct_mesh_4, N=True)  # -> out, A; inputs M: Mesh; same code as mesh_explode
空间三维点阵 = 空间三维点阵(起始点=Point(0, 0, 0), 起始平面=PlaneXY(0, 0, 0), X方向数量=5, Y方向数量=5, Z方向数量=5, X方向的间距=10, Y方向的间距=10, Z方向的间距=10)
weaverbird_s_face_polylines_4 = WeaverbirdsFacePolylines(Mesh=mesh_explode_4.A)
三角形多面体 = 三角形多面体(参考平面=point_10, 半径=Slider(9, range=0..100), 封面=False)  # -> 外轮廓, 多面体
area_4 = Area(Geometry=construct_mesh_4)  # -> Area, Centroid
deconstruct_mesh_8 = DeconstructMesh(Mesh=construct_mesh_4)  # -> Vertices, Faces, Colours, Normals
多边形套管 = 多边形套管(轨迹曲线=curve_2, 半径=Slider(12, range=0..100), 边数=6, 旋转角度=0)
explode_4 = Explode(Curve=weaverbird_s_face_polylines_4, Recursive=True)  # -> flatten(Segments), Vertices
point_11 = Point(area_4.Centroid)
boundary_surfaces = BoundarySurfaces(Edges=三角形多面体.外轮廓)
curve_3 = Curve(三角形多面体.外轮廓)
end_points_7 = EndPoints(Curve=curve_3)  # -> Start, End
removeduplicatelines_6 = RemoveDuplicateLines(Lines=explode_4.Segments, Tolerance=0.01)  # -> flatten(UniqueLines)
area_5 = Area(Geometry=boundary_surfaces)  # -> Area, Centroid
scale_4 = Scale(Geometry=removeduplicatelines_6, Center=point_11, Factor=Slider(1.32287, range=0..10))  # -> flatten(Geometry), Transform
point_12 = Point(area_5.Centroid)
end_points_8 = EndPoints(Curve=scale_4.Geometry)  # -> Start, End
end_points_9 = EndPoints(Curve=removeduplicatelines_6)  # -> Start, End
removeduplicatepts_7 = RemoveDuplicatePts(Points=end_points_8.Start, Tolerance=0.01)
removeduplicatepts_8 = RemoveDuplicatePts(Points=end_points_9.Start, Tolerance=0.01)
line_4 = Line(StartPoint=removeduplicatepts_8, EndPoint=removeduplicatepts_7)
removeduplicatelines_7 = RemoveDuplicateLines(Lines=explode.Segments, Tolerance=0.01)  # -> flatten(UniqueLines)
removeduplicatelines_8 = RemoveDuplicateLines(Lines=explode_2.Segments, Tolerance=0.01)  # -> flatten(UniqueLines)
curve_4 = Curve([<curve referenced from the Rhino model> x284])
curve_5 = Curve([<curve referenced from the Rhino model> x232])
removeduplicatelines_9 = RemoveDuplicateLines(Lines=curve_4, Tolerance=0.01)
removeduplicatelines_10 = RemoveDuplicateLines(Lines=curve_5, Tolerance=0.01)
param_viewer_2 = ParamViewer(removeduplicatelines_9)
panel_2 = Panel(removeduplicatelines_9)
param_viewer_3 = ParamViewer(removeduplicatelines_10)
panel_3 = Panel(removeduplicatelines_10)
