# Grasshopper definition 20230515-3.gh (Grasshopper 1.0.7)

Z = Z轴向量(向量大小="-20000")
曲线 = 曲线(<曲线 referenced from the Rhino model>)
偏移 = 偏移曲线(曲线=曲线, 距离=100, 平面=PlaneXY(0, 0, 0), 角点=1)
挤出 = 挤出(线或曲面=曲线, 向量=Z)
偏移_2 = 偏移曲线(曲线=曲线, 距离="-100", 平面=PlaneXY(0, 0, 0), 角点=1)
crv = Curve(<curve referenced from the Rhino model>)
测量长度 = 测量长度(曲线=曲线)
除法 = 除法(被除数=测量长度, 除数=10)
crv_2 = Curve(<curve referenced from the Rhino model>)
测量长度_2 = 测量长度(曲线=曲线)
曲线之段数等分 = 曲线之段数等分(要等分的曲线=偏移, 段数=除法, 是否打断=False)  # -> 等分点, 等分点向量, 等分点参数
除法_2 = 除法(被除数=测量长度_2, 除数=10)
曲线之段数等分_2 = 曲线之段数等分(要等分的曲线=偏移_2, 段数=除法_2, 是否打断=False)  # -> 等分点, 等分点向量, 等分点参数
移动 = 移动(几何体=曲线之段数等分.等分点, 向量=Z)  # -> 移动后的物体, 变形数据
偏移_3 = 偏移曲线(曲线=曲线, 距离=0, 平面=PlaneXY(0, 0, 0), 角点=1)
移动_2 = 移动(几何体=曲线之段数等分_2.等分点, 向量=Z)  # -> 移动后的物体, 变形数据
测量长度_3 = 测量长度(曲线=曲线)
直线 = 直线(起点=曲线之段数等分.等分点, 终点=移动.移动后的物体)
除法_3 = 除法(被除数=测量长度_3, 除数=10)
网格 = 网格(<网格 referenced from the Rhino model>)
直线_2 = 直线(起点=曲线之段数等分_2.等分点, 终点=移动_2.移动后的物体)
网格相交曲线 = 网格曲线相交(网格=网格, 曲线=直线)  # -> flatten(交点), 索引值
曲线之段数等分_3 = 曲线之段数等分(要等分的曲线=偏移_3, 段数=除法_3, 是否打断=False)  # -> 等分点, 等分点向量, 等分点参数
mesh = Mesh(<mesh referenced from the Rhino model>)
网格相交曲线_2 = 网格曲线相交(网格=mesh, 曲线=直线_2)  # -> flatten(交点), 索引值
最近点之曲面 = 最近点之曲面(指定点=网格相交曲线.交点, 曲面=挤出)  # -> 最近点, UV点, 距离
移动_3 = 移动(几何体=曲线之段数等分_3.等分点, 向量=Z)  # -> 移动后的物体, 变形数据
最近点之曲面_2 = 最近点之曲面(指定点=网格相交曲线_2.交点, 曲面=挤出)  # -> 最近点, UV点, 距离
Y = UnitY(Factor="-8300")
X = UnitX(Factor="10")
curvature = Curvature(Curve=曲线, Parameter=曲线之段数等分_3.等分点参数)  # -> P, K, C
X_2 = UnitX(Factor="470")
直线_3 = 直线(起点=曲线之段数等分_3.等分点, 终点=移动_3.移动后的物体)
旋转 = _2D旋转(要旋转的物体=最近点之曲面_2.UV点, 旋转角度=1.570796327, 旋转平面=PlaneXY(-2640.09723, 3042.955399, 0))  # -> 旋转后的物体, 变形数据
area = Area(Geometry=curvature.C)  # -> Area, Centroid
网格相交曲线_3 = 网格曲线相交(网格=网格, 曲线=直线_3)  # -> flatten(交点), 索引值
曲线_2 = 曲线(<曲线 referenced from the Rhino model>)
xz = XZPlane(Origin=Point(0, 0, 0))
dist = Distance(PointA=curvature.P, PointB=area.Centroid)  # -> reverse(Distance)
pt = Point(xz)
arrlinear = LinearArray(Geometry=pt, Direction=X, Count=3305)  # -> Geometry, Transform
move = Move(Geometry=arrlinear.Geometry, Motion=Y)  # -> Geometry, Transform
move_2 = Move(Geometry=move.Geometry, Motion=X_2)  # -> Geometry, Transform
镜像 = 镜像(几何体=旋转.旋转后的物体, 镜像平面=xz)  # -> 镜像后的物体, 变形数据
测量长度_4 = 测量长度(曲线=曲线_2)
one_over_x = OneOverX(Value=dist)
最近点之曲面_3 = 最近点之曲面(指定点=网格相交曲线_3.交点, 曲面=挤出)  # -> 最近点, UV点, 距离
旋转_2 = _2D旋转(要旋转的物体=最近点之曲面.UV点, 旋转角度=1.570796327, 旋转平面=PlaneXY(-2640.09723, 3042.955399, 0))  # -> 旋转后的物体, 变形数据
整除 = 整除(被除数=测量长度, 除数=测量长度_4)
xz_2 = XZPlane(Origin=Point(0, 0, 0))
三向缩放 = 三向缩放(要缩放的物体=镜像.镜像后的物体, 参考平面=PlaneXY(0, 0, 0), X方向缩放系数=整除, Y方向缩放系数=1, Z方向缩放系数=1)  # -> 缩放后的物体, 变形数据
点 = 点(最近点之曲面_3.UV点)
镜像_2 = 镜像(几何体=旋转_2.旋转后的物体, 镜像平面=xz_2)  # -> 镜像后的物体, 变形数据
xz_3 = XZPlane(Origin=Point(0, 0, 0))
镜像_3 = 镜像(几何体=三向缩放.缩放后的物体, 镜像平面=xz_3)  # -> 镜像后的物体, 变形数据
三向缩放_2 = 三向缩放(要缩放的物体=镜像_2.镜像后的物体, 参考平面=PlaneXY(0, 0, 0), X方向缩放系数=整除, Y方向缩放系数=1, Z方向缩放系数=1)  # -> reverse(缩放后的物体), 变形数据
旋转_3 = _2D旋转(要旋转的物体=点, 旋转角度=1.570796327, 旋转平面=PlaneXY(-2640.09723, 3042.955399, 0))  # -> 旋转后的物体, 变形数据
Y_2 = UnitY(Factor="-16600")
move_3 = Move(Geometry=镜像_3.镜像后的物体, Motion=Y_2)  # -> Geometry, Transform
曲线_3 = 曲线(<曲线 referenced from the Rhino model>)
测量长度_5 = 测量长度(曲线=曲线_3)
shift = ShiftList(List=三向缩放_2.缩放后的物体, Shift=1, Wrap=False)
Z_2 = UnitZ(Factor="500")
move_4 = Move(Geometry=最近点之曲面.最近点, Motion=Z_2)  # -> Geometry, Transform
xz_4 = XZPlane(Origin=Point(0, 0, 0))
镜像_4 = 镜像(几何体=旋转_3.旋转后的物体, 镜像平面=xz_4)  # -> 镜像后的物体, 变形数据
整除_2 = 整除(被除数=测量长度_3, 除数=测量长度_5)
pdecon = Deconstruct(Point=三向缩放_2.缩放后的物体)  # -> XComponent, YComponent, ZComponent
pdecon_2 = Deconstruct(Point=shift)  # -> XComponent, YComponent, ZComponent
shift_2 = ShiftList(List=move_3.Geometry, Shift=1, Wrap=False)
ln = Line(StartPoint=最近点之曲面.最近点, EndPoint=move_4.Geometry)
pdecon_3 = Deconstruct(Point=move_3.Geometry)  # -> XComponent, YComponent, ZComponent
pdecon_4 = Deconstruct(Point=shift_2)  # -> XComponent, YComponent, ZComponent
三向缩放_3 = 三向缩放(要缩放的物体=镜像_4.镜像后的物体, 参考平面=PlaneXY(0, 0, 0), X方向缩放系数=整除_2, Y方向缩放系数=1, Z方向缩放系数=1)  # -> 缩放后的物体, 变形数据
subtraction = Subtraction(A=pdecon_2.XComponent, B=pdecon.XComponent)
smaller = SmallerThan(FirstNumber=subtraction, SecondNumber=10)  # -> SmallerThan, OrEqualTo
larger = LargerThan(FirstNumber=subtraction, SecondNumber=10)  # -> LargerThan, OrEqualTo
multiplication = Multiplication(A=one_over_x, B=smaller.OrEqualTo)
multiplication_2 = Multiplication(A=one_over_x, B=larger.OrEqualTo)
multiplication_3 = Multiplication(A=multiplication, B="-50000")
multiplication_4 = Multiplication(A=multiplication_2, B="50000")
Y_3 = UnitY(Factor=multiplication_3)
Y_4 = UnitY(Factor=multiplication_4)
move_5 = Move(Geometry=move_2.Geometry, Motion=Y_3)  # -> Geometry, Transform
move_6 = Move(Geometry=move_2.Geometry, Motion=Y_4)  # -> Geometry, Transform
merge = Merge(Data1=move_6.Geometry, Data2=move_5.Geometry)
pdecon_5 = Deconstruct(Point=merge)  # -> XComponent, YComponent, ZComponent
equals = Equality(FirstNumber=pdecon_5.YComponent, SecondNumber="-8300")  # -> Equality, Inequality
dispatch = Dispatch(List=merge, DispatchPattern=equals.Inequality)  # -> ListA, ListB
pt_2 = Point(dispatch.ListA)
pdecon_6 = Deconstruct(Point=pt_2)  # -> XComponent, YComponent, ZComponent
sort = SortList(Keys=pdecon_6.XComponent, ValuesA=pt_2)  # -> Keys, ValuesA
pline = PolyLine(Vertices=sort.ValuesA, Closed=False)
xz_5 = XZPlane(Origin=Point(0, 0, 0))
subtraction_2 = Subtraction(A=pdecon_3.XComponent, B=pdecon_4.XComponent)
sort_2 = SortList(Keys=subtraction_2, ValuesValuesA=subtraction_2)  # -> Keys, ValuesValuesA
sort_3 = SortList(Keys=subtraction, ValuesValuesA=subtraction)  # -> Keys, ValuesValuesA
镜像_5 = 镜像(几何体=三向缩放_3.缩放后的物体, 镜像平面=xz_5)  # -> 镜像后的物体, 变形数据
Y_5 = UnitY(Factor="-16600")
move_7 = Move(Geometry=镜像_5.镜像后的物体, Motion=Y_5)  # -> Geometry, Transform
larger_2 = LargerThan(FirstNumber=subtraction, SecondNumber="0")  # -> LargerThan, OrEqualTo
smaller_2 = SmallerThan(FirstNumber=subtraction, SecondNumber="8.6")  # -> SmallerThan, OrEqualTo
larger_3 = LargerThan(FirstNumber=subtraction, SecondNumber="9.7")  # -> LargerThan, OrEqualTo
smaller_3 = SmallerThan(FirstNumber=subtraction, SecondNumber="10.3")  # -> SmallerThan, OrEqualTo
larger_4 = LargerThan(FirstNumber=subtraction, SecondNumber="10.3")  # -> LargerThan, OrEqualTo
smaller_4 = SmallerThan(FirstNumber=subtraction, SecondNumber="10.93")  # -> SmallerThan, OrEqualTo
larger_5 = LargerThan(FirstNumber=subtraction, SecondNumber="10.93")  # -> LargerThan, OrEqualTo
smaller_5 = SmallerThan(FirstNumber=subtraction, SecondNumber="11.60")  # -> SmallerThan, OrEqualTo
larger_6 = LargerThan(FirstNumber=subtraction, SecondNumber="11.60")  # -> LargerThan, OrEqualTo
smaller_6 = SmallerThan(FirstNumber=subtraction, SecondNumber="9999")  # -> SmallerThan, OrEqualTo
larger_7 = LargerThan(FirstNumber=subtraction, SecondNumber="8.6")  # -> LargerThan, OrEqualTo
smaller_7 = SmallerThan(FirstNumber=subtraction, SecondNumber="9.13")  # -> SmallerThan, OrEqualTo
larger_8 = LargerThan(FirstNumber=subtraction, SecondNumber="9.13")  # -> LargerThan, OrEqualTo
smaller_8 = SmallerThan(FirstNumber=subtraction, SecondNumber="9.7")  # -> SmallerThan, OrEqualTo
larger_9 = LargerThan(FirstNumber=subtraction_2, SecondNumber="0")  # -> LargerThan, OrEqualTo
smaller_9 = SmallerThan(FirstNumber=subtraction_2, SecondNumber="8.6")  # -> SmallerThan, OrEqualTo
larger_10 = LargerThan(FirstNumber=subtraction_2, SecondNumber="8.6")  # -> LargerThan, OrEqualTo
smaller_10 = SmallerThan(FirstNumber=subtraction_2, SecondNumber="9.13")  # -> SmallerThan, OrEqualTo
larger_11 = LargerThan(FirstNumber=subtraction_2, SecondNumber="9.13")  # -> LargerThan, OrEqualTo
smaller_11 = SmallerThan(FirstNumber=subtraction_2, SecondNumber="9.7")  # -> SmallerThan, OrEqualTo
larger_12 = LargerThan(FirstNumber=subtraction_2, SecondNumber="9.7")  # -> LargerThan, OrEqualTo
smaller_12 = SmallerThan(FirstNumber=subtraction_2, SecondNumber="10.3")  # -> SmallerThan, OrEqualTo
larger_13 = LargerThan(FirstNumber=subtraction_2, SecondNumber="10.3")  # -> LargerThan, OrEqualTo
smaller_13 = SmallerThan(FirstNumber=subtraction_2, SecondNumber="10.93")  # -> SmallerThan, OrEqualTo
larger_14 = LargerThan(FirstNumber=subtraction_2, SecondNumber="10.93")  # -> LargerThan, OrEqualTo
smaller_14 = SmallerThan(FirstNumber=subtraction_2, SecondNumber="11.60")  # -> SmallerThan, OrEqualTo
larger_15 = LargerThan(FirstNumber=subtraction_2, SecondNumber="11.60")  # -> LargerThan, OrEqualTo
smaller_15 = SmallerThan(FirstNumber=subtraction_2, SecondNumber="9999")  # -> SmallerThan, OrEqualTo
larger_16 = LargerThan(FirstNumber=subtraction, SecondNumber="0")  # -> LargerThan, OrEqualTo
smaller_16 = SmallerThan(FirstNumber=subtraction, SecondNumber="8.6")  # -> SmallerThan, OrEqualTo
larger_17 = LargerThan(FirstNumber=subtraction, SecondNumber="8.6")  # -> LargerThan, OrEqualTo
smaller_17 = SmallerThan(FirstNumber=subtraction, SecondNumber="9.13")  # -> SmallerThan, OrEqualTo
larger_18 = LargerThan(FirstNumber=subtraction, SecondNumber="9.13")  # -> LargerThan, OrEqualTo
smaller_18 = SmallerThan(FirstNumber=subtraction, SecondNumber="9.7")  # -> SmallerThan, OrEqualTo
larger_19 = LargerThan(FirstNumber=subtraction, SecondNumber="9.7")  # -> LargerThan, OrEqualTo
smaller_19 = SmallerThan(FirstNumber=subtraction, SecondNumber="10.3")  # -> SmallerThan, OrEqualTo
larger_20 = LargerThan(FirstNumber=subtraction, SecondNumber="10.3")  # -> LargerThan, OrEqualTo
smaller_20 = SmallerThan(FirstNumber=subtraction, SecondNumber="10.93")  # -> SmallerThan, OrEqualTo
larger_21 = LargerThan(FirstNumber=subtraction, SecondNumber="10.93")  # -> LargerThan, OrEqualTo
smaller_21 = SmallerThan(FirstNumber=subtraction, SecondNumber="11.60")  # -> SmallerThan, OrEqualTo
larger_22 = LargerThan(FirstNumber=subtraction, SecondNumber="11.60")  # -> LargerThan, OrEqualTo
smaller_22 = SmallerThan(FirstNumber=subtraction, SecondNumber="9999")  # -> SmallerThan, OrEqualTo
and = GateAnd(A=larger_2.LargerThan, B=smaller_2.SmallerThan)
and_2 = GateAnd(A=larger_3.OrEqualTo, B=smaller_3.SmallerThan)
and_3 = GateAnd(A=larger_4.OrEqualTo, B=smaller_4.SmallerThan)
and_4 = GateAnd(A=larger_5.OrEqualTo, B=smaller_5.SmallerThan)
and_5 = GateAnd(A=larger_6.OrEqualTo, B=smaller_6.SmallerThan)
and_6 = GateAnd(A=larger_7.OrEqualTo, B=smaller_7.SmallerThan)
and_7 = GateAnd(A=larger_8.OrEqualTo, B=smaller_8.SmallerThan)
and_8 = GateAnd(A=larger_9.OrEqualTo, B=smaller_9.SmallerThan)
and_9 = GateAnd(A=larger_10.OrEqualTo, B=smaller_10.SmallerThan)
and_10 = GateAnd(A=larger_11.OrEqualTo, B=smaller_11.SmallerThan)
and_11 = GateAnd(A=larger_12.OrEqualTo, B=smaller_12.SmallerThan)
and_12 = GateAnd(A=larger_13.OrEqualTo, B=smaller_13.SmallerThan)
and_13 = GateAnd(A=larger_14.OrEqualTo, B=smaller_14.SmallerThan)
and_14 = GateAnd(A=larger_15.OrEqualTo, B=smaller_15.SmallerThan)
and_15 = GateAnd(A=larger_16.LargerThan, B=smaller_16.SmallerThan)
and_16 = GateAnd(A=larger_17.OrEqualTo, B=smaller_17.SmallerThan)
and_17 = GateAnd(A=larger_18.OrEqualTo, B=smaller_18.SmallerThan)
and_18 = GateAnd(A=larger_19.OrEqualTo, B=smaller_19.SmallerThan)
and_19 = GateAnd(A=larger_20.OrEqualTo, B=smaller_20.SmallerThan)
and_20 = GateAnd(A=larger_21.OrEqualTo, B=smaller_21.SmallerThan)
and_21 = GateAnd(A=larger_22.OrEqualTo, B=smaller_22.SmallerThan)
dispatch_2 = Dispatch(List=三向缩放_2.缩放后的物体, DispatchPattern=and)  # -> ListA, ListB
dispatch_3 = Dispatch(List=三向缩放_2.缩放后的物体, DispatchPattern=and_2)  # -> ListA, ListB
dispatch_4 = Dispatch(List=三向缩放_2.缩放后的物体, DispatchPattern=and_3)  # -> ListA, ListB
dispatch_5 = Dispatch(List=三向缩放_2.缩放后的物体, DispatchPattern=and_4)  # -> ListA, ListB
dispatch_6 = Dispatch(List=三向缩放_2.缩放后的物体, DispatchPattern=and_5)  # -> ListA, ListB
dispatch_7 = Dispatch(List=三向缩放_2.缩放后的物体, DispatchPattern=and_6)  # -> ListA, ListB
dispatch_8 = Dispatch(List=三向缩放_2.缩放后的物体, DispatchPattern=and_7)  # -> ListA, ListB
dispatch_9 = Dispatch(List=move_3.Geometry, DispatchPattern=and_8)  # -> ListA, ListB
dispatch_10 = Dispatch(List=move_3.Geometry, DispatchPattern=and_9)  # -> ListA, ListB
dispatch_11 = Dispatch(List=move_3.Geometry, DispatchPattern=and_10)  # -> ListA, ListB
dispatch_12 = Dispatch(List=move_3.Geometry, DispatchPattern=and_11)  # -> ListA, ListB
dispatch_13 = Dispatch(List=move_3.Geometry, DispatchPattern=and_12)  # -> ListA, ListB
dispatch_14 = Dispatch(List=move_3.Geometry, DispatchPattern=and_13)  # -> ListA, ListB
dispatch_15 = Dispatch(List=move_3.Geometry, DispatchPattern=and_14)  # -> ListA, ListB
dispatch_16 = Dispatch(List=ln, DispatchPattern=and_15)  # -> ListA, ListB
dispatch_17 = Dispatch(List=ln, DispatchPattern=and_16)  # -> ListA, ListB
dispatch_18 = Dispatch(List=ln, DispatchPattern=and_17)  # -> ListA, ListB
dispatch_19 = Dispatch(List=ln, DispatchPattern=and_18)  # -> ListA, ListB
dispatch_20 = Dispatch(List=ln, DispatchPattern=and_19)  # -> ListA, ListB
dispatch_21 = Dispatch(List=ln, DispatchPattern=and_20)  # -> ListA, ListB
dispatch_22 = Dispatch(List=ln, DispatchPattern=and_21)  # -> ListA, ListB
crv_cp = CurveClosestPoint(Point=dispatch_2.ListA, Curve=<geometry referenced from the Rhino model>)  # -> Point, Parameter, Distance
crv_cp_2 = CurveClosestPoint(Point=dispatch_3.ListA, Curve=<geometry referenced from the Rhino model>)  # -> Point, Parameter, Distance
crv_cp_3 = CurveClosestPoint(Point=dispatch_4.ListA, Curve=<geometry referenced from the Rhino model>)  # -> Point, Parameter, Distance
crv_cp_4 = CurveClosestPoint(Point=dispatch_5.ListA, Curve=<geometry referenced from the Rhino model>)  # -> Point, Parameter, Distance
crv_cp_5 = CurveClosestPoint(Point=dispatch_6.ListA, Curve=<geometry referenced from the Rhino model>)  # -> Point, Parameter, Distance
crv_cp_6 = CurveClosestPoint(Point=dispatch_7.ListA, Curve=<geometry referenced from the Rhino model>)  # -> Point, Parameter, Distance
crv_cp_7 = CurveClosestPoint(Point=dispatch_8.ListA, Curve=<geometry referenced from the Rhino model>)  # -> Point, Parameter, Distance
Y_6 = UnitY(Factor="-80")
crv_cp_8 = CurveClosestPoint(Point=dispatch_9.ListA, Curve=<geometry referenced from the Rhino model>)  # -> Point, Parameter, Distance
crv_cp_9 = CurveClosestPoint(Point=dispatch_10.ListA, Curve=<geometry referenced from the Rhino model>)  # -> Point, Parameter, Distance
crv_cp_10 = CurveClosestPoint(Point=dispatch_11.ListA, Curve=<geometry referenced from the Rhino model>)  # -> Point, Parameter, Distance
crv_cp_11 = CurveClosestPoint(Point=dispatch_12.ListA, Curve=<geometry referenced from the Rhino model>)  # -> Point, Parameter, Distance
crv_cp_12 = CurveClosestPoint(Point=dispatch_13.ListA, Curve=<geometry referenced from the Rhino model>)  # -> Point, Parameter, Distance
crv_cp_13 = CurveClosestPoint(Point=dispatch_14.ListA, Curve=<geometry referenced from the Rhino model>)  # -> Point, Parameter, Distance
crv_cp_14 = CurveClosestPoint(Point=dispatch_15.ListA, Curve=<geometry referenced from the Rhino model>)  # -> Point, Parameter, Distance
move_8 = Move(Geometry=crv_cp_8.Point, Motion=Y_6)  # -> Geometry, Transform
move_9 = Move(Geometry=crv_cp_9.Point, Motion=Y_6)  # -> Geometry, Transform
move_10 = Move(Geometry=crv_cp_10.Point, Motion=Y_6)  # -> Geometry, Transform
move_11 = Move(Geometry=crv_cp_11.Point, Motion=Y_6)  # -> Geometry, Transform
move_12 = Move(Geometry=crv_cp_12.Point, Motion=Y_6)  # -> Geometry, Transform
move_13 = Move(Geometry=crv_cp_13.Point, Motion=Y_6)  # -> Geometry, Transform
move_14 = Move(Geometry=crv_cp_14.Point, Motion=Y_6)  # -> Geometry, Transform
Y_7 = UnitY(Factor="30")
Y_8 = UnitY(Factor="50")
move_15 = Move(Geometry=crv_cp.Point, Motion=Y_8)  # -> Geometry, Transform
move_16 = Move(Geometry=crv_cp_2.Point, Motion=Y_8)  # -> Geometry, Transform
move_17 = Move(Geometry=crv_cp_3.Point, Motion=Y_8)  # -> Geometry, Transform
move_18 = Move(Geometry=crv_cp_4.Point, Motion=Y_8)  # -> Geometry, Transform
move_19 = Move(Geometry=crv_cp_5.Point, Motion=Y_8)  # -> Geometry, Transform
move_20 = Move(Geometry=crv_cp_6.Point, Motion=Y_8)  # -> Geometry, Transform
move_21 = Move(Geometry=crv_cp_7.Point, Motion=Y_8)  # -> Geometry, Transform
Y_9 = UnitY(Factor="30")
move_22 = Move(Geometry=move_15.Geometry, Motion=Y_7)  # -> Geometry, Transform
move_23 = Move(Geometry=move_16.Geometry, Motion=Y_7)  # -> Geometry, Transform
move_24 = Move(Geometry=move_17.Geometry, Motion=Y_7)  # -> Geometry, Transform
move_25 = Move(Geometry=move_18.Geometry, Motion=Y_7)  # -> Geometry, Transform
move_26 = Move(Geometry=move_19.Geometry, Motion=Y_7)  # -> Geometry, Transform
move_27 = Move(Geometry=move_20.Geometry, Motion=Y_7)  # -> Geometry, Transform
move_28 = Move(Geometry=move_21.Geometry, Motion=Y_7)  # -> Geometry, Transform
move_29 = Move(Geometry=move_8.Geometry, Motion=Y_9)  # -> Geometry, Transform
move_30 = Move(Geometry=move_9.Geometry, Motion=Y_9)  # -> Geometry, Transform
move_31 = Move(Geometry=move_10.Geometry, Motion=Y_9)  # -> Geometry, Transform
move_32 = Move(Geometry=move_11.Geometry, Motion=Y_9)  # -> Geometry, Transform
move_33 = Move(Geometry=move_12.Geometry, Motion=Y_9)  # -> Geometry, Transform
move_34 = Move(Geometry=move_13.Geometry, Motion=Y_9)  # -> Geometry, Transform
move_35 = Move(Geometry=move_14.Geometry, Motion=Y_9)  # -> Geometry, Transform
ln_2 = Line(StartPoint=move_15.Geometry, EndPoint=move_22.Geometry)
ln_3 = Line(StartPoint=move_16.Geometry, EndPoint=move_23.Geometry)
ln_4 = Line(StartPoint=move_17.Geometry, EndPoint=move_24.Geometry)
ln_5 = Line(StartPoint=move_18.Geometry, EndPoint=move_25.Geometry)
ln_6 = Line(StartPoint=move_19.Geometry, EndPoint=move_26.Geometry)
ln_7 = Line(StartPoint=move_20.Geometry, EndPoint=move_27.Geometry)
ln_8 = Line(StartPoint=move_21.Geometry, EndPoint=move_28.Geometry)
ln_9 = Line(StartPoint=move_8.Geometry, EndPoint=move_29.Geometry)
ln_10 = Line(StartPoint=move_9.Geometry, EndPoint=move_30.Geometry)
ln_11 = Line(StartPoint=move_10.Geometry, EndPoint=move_31.Geometry)
ln_12 = Line(StartPoint=move_11.Geometry, EndPoint=move_32.Geometry)
ln_13 = Line(StartPoint=move_12.Geometry, EndPoint=move_33.Geometry)
ln_14 = Line(StartPoint=move_13.Geometry, EndPoint=move_34.Geometry)
ln_15 = Line(StartPoint=move_14.Geometry, EndPoint=move_35.Geometry)
division = Division(A=["0", "8.6", "9.13", "9.7", "10.3", "10.93", "11.60", "9999"], B="10")
# [0,0.860)
# [0.860, 0.913)
# [0.913, 0.970)
# [0.970, 1.030)
# [1.030, 1.093)
panel = Panel(division)
swatch = ColourSwatch(SwatchColor=RGB(0, 255, 170))
swatch_2 = ColourSwatch(SwatchColor=RGB(255, 0, 0))
swatch_3 = ColourSwatch(SwatchColor=RGB(255, 119, 0))
swatch_4 = ColourSwatch(SwatchColor=RGB(255, 204, 0))
swatch_5 = ColourSwatch(SwatchColor=RGB(255, 255, 0))
# [1.093, 1.160)
swatch_6 = ColourSwatch(SwatchColor=RGB(0, 170, 255))
# [1.160, 999)
swatch_7 = ColourSwatch(SwatchColor=RGB(4, 0, 255))
preview = CustomPreview(Geometry=ln_5, Material=swatch_6)
preview_2 = CustomPreview(Geometry=ln_6, Material=swatch_7)
preview_3 = CustomPreview(Geometry=ln_4, Material=swatch)
preview_4 = CustomPreview(Geometry=ln_2, Material=swatch_2)
preview_5 = CustomPreview(Geometry=ln_8, Material=swatch_4)
preview_6 = CustomPreview(Geometry=ln_7, Material=swatch_3)
preview_7 = CustomPreview(Geometry=ln_3, Material=swatch_5)
preview_8 = CustomPreview(Geometry=ln_9, Material=swatch_2)
preview_9 = CustomPreview(Geometry=ln_10, Material=swatch_3)
preview_10 = CustomPreview(Geometry=ln_12, Material=swatch_5)
preview_11 = CustomPreview(Geometry=ln_13, Material=swatch)
preview_12 = CustomPreview(Geometry=ln_14, Material=swatch_6)
preview_13 = CustomPreview(Geometry=ln_15, Material=swatch_7)
preview_14 = CustomPreview(Geometry=ln_11, Material=swatch_4)
preview_15 = CustomPreview(Geometry=dispatch_16.ListA, Material=swatch_2)
preview_16 = CustomPreview(Geometry=dispatch_17.ListA, Material=swatch_3)
preview_17 = CustomPreview(Geometry=dispatch_18.ListA, Material=swatch_4)
preview_18 = CustomPreview(Geometry=dispatch_19.ListA, Material=swatch_5)
preview_19 = CustomPreview(Geometry=dispatch_20.ListA, Material=swatch)
preview_20 = CustomPreview(Geometry=dispatch_21.ListA, Material=swatch_6)
preview_21 = CustomPreview(Geometry=dispatch_22.ListA, Material=swatch_7)
