# Grasshopper definition 20230515.gh (Grasshopper 1.0.7)

curve = Curve(<curve referenced from the Rhino model>)
curve_2 = Curve(<curve referenced from the Rhino model>)
length = Length(Curve=curve)
division = Division(A=length, B=500)
end_points = EndPoints(Curve=curve_2)  # -> Start, End
divide_curve = DivideCurve(Curve=curve, Count=division, Kinks=False)  # -> Points, Tangents, Parameters
series = Series(Start=0, Step=500, Count=67)
unit_x = UnitX(Factor=series)
move = Move(Geometry=end_points.Start, Motion=unit_x)  # -> Geometry, Transform
unit_y = UnitY(Factor="-20")
move_2 = Move(Geometry=move.Geometry, Motion=unit_y)  # -> Geometry, Transform
unit_y_2 = UnitY(Factor="-20")
move_3 = Move(Geometry=divide_curve.Points, Motion=unit_y_2)  # -> reverse(Geometry), Transform
point_list = PointList(Points=move_2.Geometry, Size="20")
point_list_2 = PointList(Points=move_3.Geometry, Size="20")
